vi "Init.gvi"   [LabVIEW NXG 3.0.0]
# This VI creates a dam based on it’s last logged state in the input log path.
inputs:
  "Log Path In": path
  "Reset?": bool
  "Error in": error
outputs:
  "Log Path Out": path
  "Dam out": "Dam.gtype"
  "Error out": error
types:
  "Lake properties.gtype" = cluster{"Lake Fill (Acre-feet)": f64, "Lake Intake Rate (cfs)": f64, "Lake Discharge Rate (cfs)": f64}
  "Large Floodgates properties.gtype" = cluster{"# of Large Floodgates": i32, "Large Flodgates Size (cfs)": f64, "Large Floodgates Status": bool[]}
  "Small Floodgates properties.gtype" = cluster{"# of Small Floodgates": i32, "Small Floodgates Size (cfs)": f64, "Small Floodgates Status": bool[]}
  "Turbines properties.gtype" = cluster{"# of Turbines": i32, "Power at Max Flow (MW)": f64, "Turbine Gates Status": bool[], "Turbines State (%)": f64[], "Total Power Being Generated (MW)": f64}
  "Report Data.gtype" = cluster{"Lake properties": "Lake properties.gtype", "Large Floodgates properties": "Large Floodgates properties.gtype", "Small Floodgates properties": "Small Floodgates properties.gtype", "Turbines properties": "Turbines properties.gtype"}
uses:
  Lake.gtype::Init.gvi
  Floodgate.gtype::Init.gvi
  Turbine.gtype::Init.gvi
  Report.gtype::Open or Create.gvi
diagram:
  w1 = "Report Data.gtype" {"Lake properties"={"Lake Fill (Acre-feet)"=0, "Lake Intake Rate (cfs)"=0, "Lake Discharge Rate (cfs)"=0}, "Large Floodgates properties"={"# of Large Floodgates"=4, "Large Flodgates Size (cfs)"=0, "Large Floodgates Status"=[]}, "Small Floodgates properties"={"# of Small Floodgates"=5, "Small Floodgates Size (cfs)"=0, "Small Floodgates Status"=[]}, "Turbines properties"={"# of Turbines"=2, "Power at Max Flow (MW)"=0, "Turbine Gates Status"=[], "Turbines State (%)"=[], "Total Power Being Generated (MW)"=0}}
  case ($"Error in") {
    frame No Error {
      Property Node(instance in=w1) -> ("Lake properties"=w5, "Large Floodgates properties"=w6, "Small Floodgates properties"=w7, "Turbines properties"=w8)
      Property Node(instance in=w5) -> ("Lake Fill (Acre-feet)"=w9, "Lake Intake Rate (cfs)"=w10, "Lake Discharge Rate (cfs)"=w11)
      call "Init.gvi"(Fill (Acre-feet)=w9, Intake Rate (cfs)=w10, Discharge Rate (cfs)=w11, Error in=$"Error in") -> (Lake out=w12, Error out=w13)
      Property Node(instance in=w6) -> ("# of Large Floodgates"=w14, "Large Flodgates Size (cfs)"=w15, "Large Floodgates Status"=w16)
      s1 = $"Error in"  # shift register
      for (N = w14) (iteration -> i1) {
        Array Index(array=w16) -> (out0[i1]=w18)
        call "Init.gvi"(Size (cfs)=w15, State (FALSE = Closed)=w18, Error in=s1) -> (Floodgate out=w19, Error out=w20)
        append w19 to w17
        next s1 = w20
      }
      Property Node(instance in=w7) -> ("# of Small Floodgates"=w21, "Small Floodgates Size (cfs)"=w22, "Small Floodgates Status"=w23)
      s2 = $"Error in"  # shift register
      for (N = w21) (iteration -> i2) {
        Array Index(array=w23) -> (out0[i2]=w25)
        call "Init.gvi"(Size (cfs)=w22, State (FALSE = Closed)=w25, Error in=s2) -> (Floodgate out=w26, Error out=w27)
        append w26 to w24
        next s2 = w27
      }
      Property Node(instance in=w8) -> ("# of Turbines"=w28, "Power at Max Flow (MW)"=w29, "Turbine Gates Status"=w30, "Turbines State (%)"=w31)
      s3 = $"Error in"  # shift register
      for (N = w28) (iteration -> i3) {
        Array Index(array=w30) -> (out0[i3]=w33)
        Array Index(array=w31) -> (out0[i3]=w34)
        call "Init.gvi"(Power at Max Flow (MW)=w29, Gate State (FALSE = Closed)=w33, Open Percentage (%)=w34, Error in=s3) -> (Turbine out=w35, Error out=w36)
        append w35 to w32
        next s3 = w36
      }
      call "Open or Create.gvi"(Log Path In=$"Log Path In", Error in=$"Error in") -> (Report out=w37, Log Path Out=w4, Error out=w38)
      Merge Errors(w13, s1, s2, s3, w38) -> (error out=w39)
      Property Node(instance in="Dam.gtype" constant, "Report"=w37, "Lake"=w12, "Turbines"=w32, "Large floodgates"=w17, "Small floodgates"=w24, error in=w39) -> (error out=w2, instance out=w3)
    }
    frame Error {
      w2 = $"Error in"
      w3 = "Dam.gtype" constant
      w4 = default
    }
  }
  $"Log Path Out" <- w4
  $"Dam out" <- w3
  $"Error out" <- w2
