vi "Main.gviweb"   [LabVIEW NXG 3.0.0]
# This template is for the Queued Message Handler design pattern. The Event Handling Loop generates messages based on user interface actions. The Message Handling Loop processes messages generated by the Event Handling Loop, or by other messages. The messages are string values, so new messages can be added easily to the Message Cases case structure in the Message Handling Loop. Each message cluster can also provide an optional value for Message Data,  which is a String that can be swapped to whatever type of data is required.
panel controls:
  "Do Something <Replace Me>": bool
  "Do Something Else <Replace Me>": bool
  "Exit": bool
panel indicators:
  "Display <Replace Me>": string
types:
  T1 = cluster{"Boolean <Replace Me>": bool, "String <Replace Me>": string, "Numeric <Replace Me>": f64}
uses:
  Application::support::Message Queue::Create All Message Queues.gviweb
  Application::support::Message Queue::Dequeue Message.gviweb
  Application::support::Message Queue::Enqueue Message (Single).gviweb
  NI::G Core::Error::Build Error Cluster.gvi
  Application::support::Error Handler - Message Handling Loop.gviweb
  Application::support::Error Handler - Event Handling Loop.gviweb
diagram:
  w1 = bool FALSE  # Stop Event
  Create User Event[EventName="Stop Event"](user event data type=w1) -> (error out=w2, user event out=w3)
  # This shift register stores the data for the message handler
  call "Create All Message Queues.gviweb"(error in=w2) -> (message queues=w4, error out=w5)
  Property Node(instance in=w4) -> ("UI"=w6)
  # This is the Queued Message Handler design pattern. The Event Handling Loop generates messages based on user interface actions. The Message Handling Loop processes messages generated by the Event Handling Loop, or by other messages.  The messages are string values, so new messages can be added easily to the Message Cases case structure in the Message Handling Loop.  Each message cluster can also provide an optional value for Message Data, which is a String that can be swapped to whatever type of data is required.
  s1 = T1 {all zero or empty}  # shift register
  while {
    call "Dequeue Message.gviweb"(message queue in=w6, error in=w5) -> (message queue out=w7, message=w8, message data=w9, error out=w10)
    # s1: Data
    # w3: Stop Event
    case (w8) ignore case {  # Message Cases
      frame "Initialize" {
        # Bundle a sample string value.
        Property Node(instance in=s1, "String <Replace Me>"="Initial Message") -> (instance out=w12)
        call "Enqueue Message (Single).gviweb"(message queue in=w7, message="Update Display", message data="Initial Message", error in=w10) -> (error out=w11)
        w13 = default
      }
      frame "Something" {
        # #CodeNeeded - Perform whatever actions correspond to the "Something" message.
        # Send string to "Update Display" message
        call "Enqueue Message (Single).gviweb"(message queue in=w7, message="Update Display", message data="\"Do Something\" button pressed", error in=w10) -> (error out=w11)
        w12 = s1
        w13 = default
      }
      frame "Something Else" {
        # #CodeNeeded - Perform whatever actions correspond to the "Something Else" message.
        # Send string to "Update Display" message
        call "Enqueue Message (Single).gviweb"(message queue in=w7, message="Update Display", message data="\"Do Something Else\" button pressed", error in=w10) -> (error out=w11)
        w12 = s1
        w13 = default
      }
      frame "Update Display" {
        # #CodeRecommended - If you wish to decouple the Message Handling Loop from your user interface, consider creating User Events (like the "Stop" event in this VI) to message the Event Handling Loop whenever the user interface needs updating.
        $"Display <Replace Me>" <- w9
        w11 = w10
        w12 = s1
        w13 = default
      }
      frame "Error" {
        # #CodeRecommended - Consider creating a system for logging errors in some way. These errors are for notification purposes only. Handling of specific errors should be performed in the message frames that generated the error.
        # #CodeRecommended - If you ever change the name of this "Error" message, you'll need to update the name in the Check Loop Error.gviweb as well.
        w11 = w10
        w12 = s1
        w13 = default
      }
      frame "---Copy This Frame---" {
        Merge Errors(w10) -> (error out=w11)
        w12 = s1
        w13 = default
      }
      frame "Exit" {
        # Release the message queue reference
        Release Queue(error in=w10, queue=w7) -> (error out=w14)
        # #CodeNeeded - Add any required cleanup code here. Add any custom error handling for an 'Exit' condition here as well.
        Generate User Event(event data=TRUE, user event=w3) -> (error out=w15)
        Merge Errors(w15, w14) -> (error out=w11)
        # Stop the VI
        w12 = s1
        w13 = TRUE
      }
      frame Default {
        w16 = "The invalid message string \"%s\" was received in the Message Handling Loop."
        Format Into String(formatString=w16, w8) -> w17
        call "Build Error Cluster.gvi"(code=1, description=w17) -> (error out=w11)
        w12 = s1
        w13 = default
      }
    }
    call "Error Handler - Message Handling Loop.gviweb"(message queue in=w7, error in=w11) -> (dup error in=w18)
    next s1 = w12
    stop if w13
  }
  Register For Events("Stop Event"=w3) -> (event registration refnum out=w19)
  s2 = w19  # shift register
  while {
    event (dynamic events = s2) {
      on "Dynamic" Stop Event {
        # The Message Handling Loop processed an "Exit" message, which fired this event to stop the Event Handling Loop.
        $"Display <Replace Me>" <- "\"Exit\" button pressed"
        w20 = TRUE
        w21 = no error
        w22 = w6
      }
      on "Do Something <Replace Me>" Value changed {
        # #CodeNeeded - Send the appropriate message for this user
        # interface event.
        call "Enqueue Message (Single).gviweb"(message queue in=w6, message="Something") -> (message queue out=w22)
        w20 = default
        w21 = default
      }
      on "Do Something Else <Replace Me>" Value changed {
        # #CodeNeeded - Send the appropriate message for this user
        # interface event.
        call "Enqueue Message (Single).gviweb"(message queue in=w6, message="Something Else") -> (message queue out=w22, error out=w21)
        w20 = default
      }
      on "Exit" Value changed {
        call "Enqueue Message (Single).gviweb"(priority message=TRUE, message queue in=w6, message="Exit") -> (message queue out=w22, error out=w21)
        w20 = default
      }
    }
    call "Error Handler - Event Handling Loop.gviweb"(message queue in=w22, error in=w21) -> (dup error in=w23)
    stop if w20
  }
  Unregister For Events(error in=w23, event registration refnum=s2) -> (error out=w24)
  Merge Errors(w24, w18) -> (error out=w25)
  Destroy User Event(error in=w25, user event=w3)
